# Grasshopper definition 1 structure analysis.gh (Grasshopper 1.0.7)
# plug-ins: Kiwi3d, MetaHopper, Heteroptera, K2Engineering, PlanktonGh, Human

input = DataInput(
    Destination="\\Mac\Home\Desktop\MPDA\s2\s2_3ways\s2_3ways\0 form finding.ghdata",
    RelativePath="\\Mac\Home\Desktop\MPDA\s2\s2_3ways\s2_3ways\0 form finding.ghdata|0 form finding.ghdata",
    UpdateDelay=5)  # -> mesh, _3ways_lines, line_index_weavebird_mesh_edges
line = Line(input._3ways_lines)
mesh = Mesh(input.mesh)
demesh = DeconstructMesh(Mesh=mesh)  # -> flatten(Vertices), Faces, Colours, Normals
join = JoinCurves(Curves=line, Preserve=False)
explode = Explode(Curve=join, Recursive=True)  # -> Segments, Vertices
patch = Patch(Points=demesh.Vertices, Spans=20, Flexibility=1, Trim=True)
intcrv = Interpolate(Vertices=explode.Vertices, Degree=3, Periodic=False, KnotStyle=1)  # -> reparameterize(simplify(Curve)), Length, Domain
pshift = ShiftPaths(Data=intcrv.Curve, Offset=-1)
crv_cp = CurveClosestPoint(Point=explode.Vertices, Curve=intcrv.Curve)  # -> Point, Parameter, Distance

the_surface = Surface(patch)
srf_cp = SurfaceClosestPoint(Point=crv_cp.Point, Surface=the_surface)  # -> Point, UVPoint, Distance
evalsrf = EvaluateSurface(Surface=the_surface, Point=srf_cp.UVPoint)  # -> Point, Normal, UDirection, VDirection, Frame
vec = Vector(simplify(evalsrf.Normal))
section_axis = SectionAxis(CurveParameter=crv_cp.Parameter, SectionAxis=vec)

# ---- group: Plywood material
list = ValueList({"LIN_ELAST_ISOTROPIC": 1}, selected="LIN_ELAST_ISOTROPIC")
mat = Material(Name="Plywood", Type=list, YoungsModulus="10050000", AlphaT=0, Nue=0, Density="0.68", Strength="40000")

# ----
toggle = BooleanToggle(True)
prestress_properties = PrestressPropertiesBeam(L=False, AB1=toggle, AB2=False, AT=toggle, N=0, M1=0, M2=0, T=0)
height = Number(0.019)
width = Number(0.1)
toggle_2 = BooleanToggle(False)
box = BoxSection(Height=height, Width=width, Thickness=0)  # -> Section, Area
crvref = CurveRefinement(PDeg=1, ElementRefU="1", IsKnotApproxElementSize=False, IsKnotSubdivision=True)
beam = BeamElement(
    C=reparameterize(intcrv.Curve),
    M=mat,
    S=box.Section,
    R=crvref,
    AB=section_axis,
    P=prestress_properties,
    HS=toggle_2,
    HE=toggle_2,
    HB=toggle_2)

list_2 = ValueList({"Displacements": 1, "Stresses": 2, "SupportForces": 3}, selected=["Displacements", "Stresses", "SupportForces"])
ldc = LoadDisplCurve(TimeStepList=[0, 10], ValueList=[0, 1])
nonlina = NonLinearAnalysis(
    Name="s2sa_test33",
    Iterations="10",
    EquilibriumAccurancy=0.001,
    OutputSetting=list_2,
    GlobalLDCurve=ldc,
    AdaptiveForceControl=0,
    OutputFrequency=1)

list_3 = ValueList({"Displacements": 1, "Stresses": 2, "SupportForces": 3}, selected=["Displacements", "Stresses", "SupportForces"])
lina = LinearAnalysis(Name="s2sa_test2", OutputSetting=list_3)

# ---- group: Material
list_4 = ValueList({"LIN_ELAST_ISOTROPIC": 1}, selected="LIN_ELAST_ISOTROPIC")
mat_2 = Material(Name="Kerto S", Type=list_4, YoungsModulus="11600000", AlphaT=0, Nue=0, Density="0.48", Strength="35000")

list_5 = ValueList({"LIN_ELAST_ISOTROPIC": 1}, selected="LIN_ELAST_ISOTROPIC")
mat_3 = Material(Name="Kerto S", Type=list_5, YoungsModulus="11600000", AlphaT=0, Nue=0, Density="0.48", Strength="35000")

# ----
path = FilePath("\\Mac\Home\Desktop\MPDA\s2\screenshot\")
capture = Capture(Path=path, Filename="pd_analysis")

crv_smooth = Curve(pshift)
toggle_3 = GroupToggle(ToggleActive=True, ToggleVisible=False)  # disabled
mesh_2 = Mesh(mesh)

bang = ExplodeTree(Data=simplify(crv_smooth))  # -> Branch0, Branch1, Branch2
crv = Curve(reparameterize(bang.Branch1))
crv_2 = Curve(reparameterize(bang.Branch0))
crv_3 = Curve(reparameterize(bang.Branch2))
merge = Merge(Data1=crv_2, Data2=crv, Data3=crv_3)

# ---- group: Wind load
pmesh = PlanktonMesh(mesh_2)
mvarea = MeshVertexArea(PlanktonMesh=pmesh)  # -> Vertices, VertexNormals
pi = Pi(Factor=Slider(0, range=0..2))
X = UnitX(Factor=1)
Z = UnitZ(Factor=1)
vrot = Rotate(Vector=X, Axis=Z, Angle=pi)
amp = Amplitude(Vector=vrot, Amplitude=Slider(0.53, range=0..2))
mwind = MeshWindLoad(Wind=amp, VertexNormals=mvarea.VertexNormals, Option=Toggle(True))
list_6 = ValueList({"DEAD": 1, "SNOW": 2, "PRES": 3, "PRES_FL": 4, "MOMENT": 5}, selected="PRES")
multiplication = Multiplication(A=mwind, B="0.001")
windload = PointLoad(Point=mvarea.Vertices, Loadtype=list_6, Direction=mvarea.VertexNormals, Value=multiplication, LoadCase=1)

# ---- group: support
end = EndPoints(Curve=crv_smooth)  # -> Start, End
pt = Point(flatten([end.Start, end.End]))
pdecon = Deconstruct(Point=pt)  # -> XComponent, YComponent, ZComponent
smaller = SmallerThan(FirstNumber=pdecon.ZComponent, SecondNumber="0.02")  # -> SmallerThan, OrEqualTo
dispatch = Dispatch(List=pt, DispatchPattern=smaller.SmallerThan)  # -> ListA, ListB
pt_2 = Point(dispatch.ListA)
suppt = SupportPoint(Point=pt_2, DispX=True, DispY=True, DispZ=True, Rotation=False, Torsion=False, TryStrongSupport=True)

# ---- group: coupling
python = GhPythonScript(cvA=flatten(crv_2), cvB=flatten(crv))  # -> out, ptLst, cv1, cv2; inputs cvA: list of Curve, cvB: list of Curve
# ---------- python: Python ----------
__author__ = "zenorm"
__version__ = "2022.04.09"

import rhinoscriptsyntax as rs
import Rhino.Geometry as rg

cv1 = []
cv2 = []
ptLst = []
for i in cvA:
    for j in cvB:
        intersect = rs.CurveCurveIntersection(i,j,-1)
        if intersect != None:
            print intersect[0][5]
            if (intersect[0][0] == 1) & (intersect[0][5] != 1.0) & (intersect[0][5] != 0.0) & (intersect[0][7] != 0.0) & (intersect[0][7] != 1.0):
                pt = intersect[0][1]
                ptLst.append(pt)
                cv1.append(i)
                cv2.append(j)
# ---------- end python ----------
python_2 = GhPythonScript(cvA=flatten(crv_2), cvB=flatten(crv_3))  # -> out, ptLst, cv1, cv2; inputs cvA: list of Curve, cvB: list of Curve
# ---------- python_2: Python ----------
__author__ = "zenorm"
__version__ = "2022.04.09"

import rhinoscriptsyntax as rs
import Rhino.Geometry as rg

cv1 = []
cv2 = []
ptLst = []
for i in cvA:
    for j in cvB:
        intersect = rs.CurveCurveIntersection(i,j,-1)
        if intersect != None:
            if (intersect[0][0] == 1) & (intersect[0][5] != 1.0) & (intersect[0][5] != 0.0) & (intersect[0][7] != 0.0) & (intersect[0][7] != 1.0):
                pt = intersect[0][1]
                ptLst.append(pt)
                cv1.append(i)
                cv2.append(j)
# ---------- end python_2 ----------
python_3 = GhPythonScript(cvA=flatten(crv), cvB=flatten(crv_3))  # -> out, ptLst, cv1, cv2; inputs cvA: list of Curve, cvB: list of Curve; same code as python_2
srf_cp_2 = SurfaceClosestPoint(Point=python.ptLst, Surface=the_surface)  # -> Point, UVPoint, Distance
srf_cp_3 = SurfaceClosestPoint(Point=python_2.ptLst, Surface=the_surface)  # -> Point, UVPoint, Distance
srf_cp_4 = SurfaceClosestPoint(Point=python_3.ptLst, Surface=the_surface)  # -> Point, UVPoint, Distance
evalsrf_2 = EvaluateSurface(Surface=the_surface, Point=srf_cp_2.UVPoint)  # -> Point, simplify(Normal), UDirection, VDirection, Frame
evalsrf_3 = EvaluateSurface(Surface=the_surface, Point=srf_cp_3.UVPoint)  # -> Point, simplify(Normal), UDirection, VDirection, Frame
evalsrf_4 = EvaluateSurface(Surface=the_surface, Point=srf_cp_4.UVPoint)  # -> Point, simplify(Normal), UDirection, VDirection, Frame
cpta = CouplingPointAxis(
    Point=graft(python_3.ptLst),
    Curve1=graft(python_3.cv1),
    Curve2=graft(python_3.cv2),
    Axis=graft(evalsrf_4.Normal),
    CheckProximity=True)
cpta_2 = CouplingPointAxis(
    Point=graft(python_2.ptLst),
    Curve1=graft(python_2.cv1),
    Curve2=graft(python_2.cv2),
    Axis=graft(evalsrf_3.Normal),
    CheckProximity=True)
cpta_3 = CouplingPointAxis(
    Point=graft(python.ptLst),
    Curve1=graft(python.cv1),
    Curve2=graft(python.cv2),
    Axis=graft(evalsrf_2.Normal),
    CheckProximity=True)
relay = Relay([cpta_3, cpta_2, cpta])

# ---- group: snow load
Z_2 = UnitZ(Factor=Slider(1.9, range=0..10))
msnow = MeshSnowLoad(Snow=Z_2, VertexNormals=mvarea.VertexNormals, Option=False)
list_7 = ValueList({"DEAD": 1, "SNOW": 2, "PRES": 3, "PRES_FL": 4, "MOMENT": 5}, selected="DEAD")
multiplication_2 = Multiplication(A=msnow, B="0.001")
snowload = PointLoad(Point=mvarea.Vertices, Loadtype=list_7, Direction=mvarea.VertexNormals, Value=multiplication_2, LoadCase=1)

# ---- group: self load
list_8 = ValueList({"DEAD": 1, "SNOW": 2, "PRES": 3, "PRES_FL": 4, "MOMENT": 5}, selected="DEAD")
panel = Panel("""Gravity
680kg/m3 * 0.1m * 0.019m * 10N / 1000 = 6.8Kn/m3 * 0.0019m2
= 0.01292 """)
crvload = CurveLoad(Crv=merge, Loadtype=list_8, Direction=Vector(0, 0, -1), Value="0.013", LoadCase=1)  # -> flatten(CurveLoad)

# ----
loads = Merge(Data1=flatten(windload), Data2=crvload, Data3=flatten(snowload))
visopt = VisualizeOptions(
    ScaleCrossSections=1,
    ScaleSupports=1,
    ScaleLoads=Slider(0.1, range=0..0.1),
    ScaleCouplingPoints=1,
    ScaleConnectingPoints=Slider(0.71, range=0..1),
    ScaleRefinedControlPoints=1,
    ColourBeam=RGB(211, 211, 211),
    ColourCable=RGB(255, 255, 255),
    ColourSupports=RGB(232, 65, 119),
    ColourLoads=RGB(232, 65, 119),
    ColourConnects=RGB(255, 255, 255),
    ColourRefinedPatches=RGB(139, 0, 0),
    ColourSliding=RGB(135, 16, 55))
amodel = AnalysisModel(
    Analysis=nonlina,
    StructuralElements=flatten(beam),
    Supports=[suppt, relay],
    Loads=loads,
    Visualizer=visopt,
    IntersectionTolerance=0.01,
    IsCarat=True,
    IsKratos=False,
    PenaltyFac=10000000,
    ShowCouplingIDs=False,
    ShowEdgeIDs=False,
    ShowGeo=True,
    ShowPatchIDs=True,
    ShowPrePro=True,
    ShowRef=False,
    mUsedVersion="BETA 0.6.0")

run_analysis = IGASolver(AnalysisModel=amodel, Run=Button(), antiFreeze=False, showWindow=True)  # -> ResultModel, ErrorReport
panel_2 = Panel(run_analysis.ErrorReport)
defmod = DeformedModel(
    Model=run_analysis.ResultModel,
    LoadCase=Slider(0, range=0..10),
    ScaleFactor=Slider(1, range=1..50),
    FlyingNodeLimit=100000)  # -> Model, Geo, DeformedStructuralElements
amodel_2 = AnalysisModel(
    StructuralElements=defmod.DeformedStructuralElements,
    IntersectionTolerance=0.01,
    IsCarat=True,
    IsKratos=False,
    PenaltyFac=10000000,
    ShowCouplingIDs=False,
    ShowEdgeIDs=False,
    ShowGeo=True,
    ShowPatchIDs=True,
    ShowPrePro=True,
    ShowRef=False,
    mUsedVersion="BETA 0.6.0")
list_9 = ValueList({"N": 1, "M1": 2, "M2": 3, "Mt": 4, "V1": 5, "V2": 6, "N stress": 7, "Shear stress 1": 8, "Shear stress 2": 9, "v Mises stress": 10, "Utilization (v Mises)": 11, "Cross Section": 12}, selected="Utilization (v Mises)")
crv_4 = Curve(defmod.Geo)
_1dresview = _1DElementResultView(Model=defmod.Model, Type=list_9, ScaleFactor=Slider(0.847, range=0..1), ShowColourPlot=True)  # -> Results, ResultList, Mesh, LegendC, LegendT
legend = Legend(Colour=_1dresview.LegendC, Tags=_1dresview.LegendT, LegendType=1)

crv_5 = Curve(flatten(crv_smooth))
series = Series(Start=0, Step=Slider(0.05, range=0..0.1), Count=Slider(20, range=0..100))
crv_6 = Curve(defmod.Geo)
eval = EvaluateCurve(Curve=reparameterize(graft(crv_5)), Parameter=series)  # -> Point, Tangent, Angle
eval_2 = EvaluateCurve(Curve=reparameterize(graft(crv_6)), Parameter=series)  # -> Point, Tangent, Angle
dist = Distance(PointA=eval.Point, PointB=eval_2.Point)
num = Number(dist)
bnd = Bounds(Numbers=num)
extremums = MinMax(Number=num)  # -> Minimum, Maximum
dedomain = DeconstructDomain(Domain=bnd)  # -> Start, End

item = ListItem(List=eval.Point, Index="18", Wrap=True)
item_2 = ListItem(List=eval_2.Point, Index="18", Wrap=True)
index = ItemIndex(List=num, Item=dedomain.End)
ln = Line(StartPoint=item, EndPoint=item_2)
panel_3 = Panel(num)
previewlw = CustomPreviewLineweights(Geometry=ln, Shader=ColourSwatch(SwatchColor=RGB(245, 54, 54)), Thickness=Slider(30, range=0..30), Absolute=False)
